# Grasshopper definition rnd_node_local_text.gh (Grasshopper 1.0.7)
# plug-ins: Kangaroo2 Components, MeshEdit Components

count = Slider(18, range=2..20)
radius = GetNumber(Slider(2.4, range=0.2..5), AtLeast=1, AtMost=1, Maximum=1.797693135e+308, Minimum=-1.797693135e+308, TreeAccess=False)
count_2 = GetNumber(count, AtLeast=1, AtMost=1, Maximum=1.797693135e+308, Minimum=-1.797693135e+308, TreeAccess=False)
division = Division(A=radius, B=10)
sph = Sphere(Base=PlaneXY(0, 0, 0), Radius="2.3")
pt = ConstructPoint(XCoordinate=0, YCoordinate=0, ZCoordinate=0)
popgeo = PopulateGeometry(Geometry=sph, Count=count_2, Seed=1)
multiplication = Multiplication(A=division, B=Slider(1, range=0..20))
ln = Line(StartPoint=pt, EndPoint=popgeo)
mp = MultiPipe(Curves=ln, NodeSize=division, EndOffset=2, StrutSize=multiplication, Segment=0, KinkAngle=0.7, CubeFit=0)
meshsubd = MeshFromSubD(SubD=mp, Density=2)
clean = CombineClean(Meshes=meshsubd)
panel = Panel(meshsubd)
mesh = Mesh(clean)
deconstruct_mesh = DeconstructMesh(Mesh=mesh)  # -> Vertices, Faces, Colours, Normals
deconstruct_vector = DeconstructVector(Vector=deconstruct_mesh.Normals)  # -> XComponent, YComponent, ZComponent
panel_2 = Panel(mesh)
construct_domain = ConstructDomain(DomainStart="100", DomainEnd="255")
remap_numbers = RemapNumbers(Value=deconstruct_vector.XComponent, Source=Domain(0, 1), Target=construct_domain)  # -> Mapped, Clipped
remap_numbers_2 = RemapNumbers(Value=deconstruct_vector.ZComponent, Source=Domain(0, 1), Target=construct_domain)  # -> Mapped, Clipped
remap_numbers_3 = RemapNumbers(Value=deconstruct_vector.YComponent, Source=Domain(0, 1), Target=construct_domain)  # -> Mapped, Clipped
list_length = ListLength(List=deconstruct_mesh.Faces)
colour_rgb = ColourRGB(Alpha=255, Red=remap_numbers.Mapped, Green=remap_numbers_3.Mapped, Blue=remap_numbers_2.Mapped)
mesh_area = MeshArea(Mesh=mesh)  # -> Area, Centroid
mesh_colours = MeshColours(Mesh=mesh, Colours=colour_rgb)
context_bake = ContextBake(Colored_mesh=mesh_colours)
context_print = ContextPrint(Mesh_faces=list_length)
context_print_2 = ContextPrint(Mesh_area=mesh_area.Area)
