# Grasshopper definition LCA_SIMPLE - Copy.gh (Grasshopper 1.0.7)

slab_thickness = Slider(0.3, range=0.1..0.8)
facade_thickness = Slider(0.35, range=0..0.5)
floor_height = Slider(3, range=0.5..10)
module_size = Slider(2, range=0.5..10)
wall_width = Slider(1, range=0.3..5)
corner_window = BooleanToggle(False)
floor_height_2 = GetNumber(floor_height, AtLeast=1, AtMost=1, Maximum=1.797693135e+308, Minimum=-1.797693135e+308, TreeAccess=False)
length = GetInteger(Slider(8, range=3..36), AtLeast=1, AtMost=1, Maximum=2147483647, Minimum=-2147483648, TreeAccess=False)
width = GetInteger(Slider(8, range=6..15), AtLeast=1, AtMost=1, Maximum=2147483647, Minimum=-2147483648, TreeAccess=False)
height = GetInteger(Slider(40, range=6..51), AtLeast=1, AtMost=1, Maximum=2147483647, Minimum=-2147483648, TreeAccess=False)
wall_width_2 = GetNumber(wall_width, AtLeast=1, AtMost=1, Maximum=1.797693135e+308, Minimum=-1.797693135e+308, TreeAccess=False)
module_size_2 = GetNumber(module_size, AtLeast=1, AtMost=1, Maximum=1.797693135e+308, Minimum=-1.797693135e+308, TreeAccess=False)
facade_material = GetInteger(Slider(0, range=0..4), AtLeast=0, AtMost=4, Maximum=2147483647, Minimum=-2147483648, TreeAccess=False)
corner = GetBoolean(corner_window, AtLeast=1, AtMost=1, FalseValue="False", TreeAccess=False, TrueValue="True")
panel_3 = Panel(".05")
panel_5 = Panel(".25")
division = Division(A=height, B=floor_height_2)
integer = Integer(expr("x*1.2", division))
center_box = CenterBox(Base=PlaneXY(0, 0, 0), X=length, Y=width, Z=expr("x/2", height))

# ---- group: GEO
debrep = DeconstructBrep(Brep=center_box)  # -> Faces, Edges, Vertices
division_2 = Division(A=Slider(1.9, range=0..10), B=2)
evalsrf = EvaluateSurface(Surface=debrep.Faces, Point="0.5,0.5")  # -> Point, Normal, UDirection, VDirection, Frame
pdecon = Deconstruct(Point=evalsrf.Normal)  # -> XComponent, YComponent, ZComponent
construct_domain = ConstructDomain(DomainStart=expr("-X", division_2), DomainEnd=division_2)
inc = Includes(Value=pdecon.ZComponent, Domain=construct_domain)  # -> Includes, Deviation
cull = CullPattern(List=debrep.Faces, CullPattern=inc.Includes)
join = BrepJoin(Breps=cull)  # -> Breps, Closed

# ----
cull_pattern = CullPattern(List=debrep.Faces, CullPattern=invert(inc.Includes))
negative = Negative(Value=facade_thickness)
unit_z = UnitZ(Factor=expr("-x", slab_thickness))
construct_domain_2 = ConstructDomain(DomainStart=expr("X*1.5", length), DomainEnd=expr("-X*1.5", length))
construct_domain_3 = ConstructDomain(DomainStart=expr("X*1.5", width), DomainEnd=expr("-X*1.5", width))
xy_plane = XYPlane(Origin=Point(0, 0, 0))
area = Area(Geometry=join.Breps)  # -> flatten(Area), Centroid
offset_curve = OffsetCurve(Curve=cull_pattern, Distance=negative, Corners=1)
surface = Surface(offset_curve)
ma = MassAddition(Input=area.Area)  # -> Result, PartialResults

# ---- group: facade
int = Integer(ma.Result)

# ----
extrude = Extrude(Base=surface, Direction=unit_z)
loft = Loft(
    Curves=flatten(offset_curve),
    Options={Adjust=False, Closed=False, LoftEnds=0, LoftSimp=0, LoftType=2, Rebuild=10, Refit=0.01})  # -> simplify(Loft)

# ---- group: DATA
debrep_2 = DeconstructBrep(Brep=loft)  # -> Faces, Edges, Vertices
pdecon_2 = Deconstruct(Point=debrep_2.Vertices)  # -> XComponent, YComponent, ZComponent
sort = SortList(Keys=pdecon_2.ZComponent, ValuesA=debrep_2.Vertices)  # -> Keys, ValuesA

item = ListItem(List=sort.ValuesA, Index=0, Wrap=True)
project = Project(Geometry=item, Plane=PlaneXY(0, 0, 0))  # -> Geometry, Transform
vec2pt = Vector2Pt(PointA=item, PointB=project.Geometry, Unitize=False)  # -> Vector, Length

item_2 = ListItem(List=sort.Keys, Index=0, Wrap=True)  # -> Item1, Item
subtraction = Subtraction(A=item_2.Item1, B=item_2.Item)
box_height = Number(subtraction)
division_3 = Division(A=box_height, B=floor_height_2)
round = Round(Number=division_3)  # -> Nearest, Floor, Ceiling
division_4 = Division(A=box_height, B=round.Floor)
num_floors = Number(division_4)

# ----
num_floors_2 = Number(num_floors)
list_item = ListItem(List=flatten(extrude), Index=0, Wrap=True)  # -> Item, Item1
series = Series(Start=0, Step=num_floors, Count=integer)
unit_z_2 = UnitZ(Factor=series)
move = Move(Geometry=xy_plane, Motion=unit_z_2)  # -> Geometry, Transform
plane_surface = PlaneSurface(Plane=move.Geometry, XSize=construct_domain_2, YSize=construct_domain_3)
number = Number(wall_width_2)
unit_z_3 = UnitZ(Factor=expr("-x", slab_thickness))

# ---- group: DATA
box = Box(center_box)
debox = DeconstructBox(Box=box)  # -> Plane, X, Y, Z
dedomain = DeconstructDomain(Domain=debox.Z)  # -> Start, graft(End)
number_2 = Number(expr("round(x,2)", dedomain.End))

# ----
unit_y = UnitY(Factor=1)
unit_x = UnitX(Factor=1)
unit_y_2 = UnitY(Factor=1)
unit_x_2 = UnitX(Factor=1)
unit_y_3 = UnitY(Factor=1)
unit_x_3 = UnitX(Factor=1)
negative_2 = Negative(Value=unit_y)
negative_3 = Negative(Value=unit_x)
negative_4 = Negative(Value=unit_y_2)
negative_5 = Negative(Value=unit_x_2)
negative_6 = Negative(Value=unit_y_3)
negative_7 = Negative(Value=unit_x_3)
unit_x_4 = UnitX(Factor=facade_thickness)
unit_y_4 = UnitY(Factor=facade_thickness)
negative_8 = Negative(Value=unit_x_4)
negative_9 = Negative(Value=unit_y_4)
stream_filter = StreamFilter(
    Gate=facade_material,
    Stream0=ColourSwatch(SwatchColor=RGB(82, 82, 82)),
    Stream1=ColourSwatch(SwatchColor=RGB(153, 132, 118)),
    Stream2=ColourSwatch(SwatchColor=RGB(209, 171, 161)),
    Stream3=ColourSwatch(SwatchColor=RGB(209, 209, 209)),
    Stream4=ColourSwatch(SwatchColor=RGB(209, 209, 209)))
panel_6 = Panel("""0.2,0.5
0.4,0.5
0.6,0.5
0.8,0.5""")
list_item_2 = ListItem(List=plane_surface, Index=0, Wrap=True)

# ---- group: AREA_FACADE
int_2 = Integer(ma.Result)

# ----
panel_7 = Panel("""concrete
timmber
brick
steel
aluminum""")
panel_8 = Panel("Material")
panel_9 = Panel("Thickness")
panel_10 = Panel("""0.10
0.05
0.24
0.02
0.02""")
panel_11 = Panel("Density kg/m3")
panel_12 = Panel("""2400
700
1700
8000
2700""")
panel_13 = Panel("kgMat")
panel_14 = Panel("Embeded kgCO2/kgMat")
panel_15 = Panel("""0.15
-1.65
0.20
1.77
8.40""")

list_item_3 = ListItem(List=panel_7, Index=facade_material, Wrap=True)
list_item_4 = ListItem(List=panel_10, Index=facade_material, Wrap=True)
subtraction_2 = Subtraction(A=facade_thickness, B=list_item_4)
list_item_5 = ListItem(List=panel_12, Index=facade_material, Wrap=True)
panel_16 = Panel(list_item_3)
list_item_6 = ListItem(List=panel_15, Index=facade_material, Wrap=True)

panel_17 = Panel(subtraction_2)

# ---- group: GEO
Z = UnitZ(Factor=slab_thickness)
rev = Reverse(Vector=Z)
neg = Negative(Value=wall_width_2)
filter = StreamFilter(Gate=corner, Stream0=neg, Stream1=wall_width_2)
division_5 = Division(A=filter, B=2)

Z_2 = UnitZ(Factor=slab_thickness)
rev_2 = Reverse(Vector=Z_2)

# ---- group: DATA
subtraction_3 = Subtraction(A=num_floors_2, B=slab_thickness)

# ---- group: GEO
move_2 = Move(Geometry=join.Breps, Motion=vec2pt.Vector)  # -> Geometry, Transform
rev_3 = Reverse(Vector=vec2pt.Vector)

# ----
brep_brep = BrepBrep(BrepA=move_2.Geometry, BrepB=plane_surface)  # -> Curves, Points

# ---- group: GEO (continued)
move_3 = Move(Geometry=flatten(brep_brep.Curves), Motion=simplify(rev_3))  # -> Geometry, Transform

move_4 = Move(Geometry=loft, Motion=vec2pt.Vector)  # -> Geometry, Transform
rev_4 = Reverse(Vector=vec2pt.Vector)

# ----
brep_brep_2 = BrepBrep(BrepA=move_4.Geometry, BrepB=plane_surface)  # -> Curves, Points

# ---- group: GEO (continued)
move_5 = Move(Geometry=flatten(brep_brep_2.Curves), Motion=simplify(rev_4))  # -> Geometry, Transform

# ---- group: LOGIC
area_2 = Area(Geometry=move_3.Geometry)  # -> Area, Centroid
area_3 = Area(Geometry=move_5.Geometry)  # -> Area, Centroid
cp = ClosestPoint(Point=area_3.Centroid, Cloud=area_2.Centroid)  # -> ClosestPoint, CPIndex, Distance
item_3 = ListItem(List=move_3.Geometry, Index=cp.CPIndex, Wrap=True)

# ----
boundary = BoundarySurfaces(Edges=move_5.Geometry)
cull_index = CullIndex(List=boundary, Indices="0", Wrap=True)
extrude_2 = Extrude(Base=cull_index, Direction=unit_z_3)
entwine = Entwine(Branch00=list_item.Item1, Branch01=extrude_2, Branch02=list_item.Item, FlattenInputs=True)  # -> flatten(Result)
volume = Volume(Geometry=entwine)  # -> Volume, Centroid
scale = Scale(Geometry=entwine, Center=volume.Centroid, Factor=Slider(0.98, range=0..1))  # -> Geometry, Transform
crv = Curve(move_5.Geometry)
join_2 = JoinCurves(Curves=item_3, Preserve=False)
area_4 = Area(Geometry=crv)  # -> Area, Centroid
pdecon_3 = Deconstruct(Point=area_4.Centroid)  # -> XComponent, YComponent, ZComponent
number_3 = Number(expr("round(x,2)", pdecon_3.ZComponent))
equals = Equality(FirstNumber=number_3, SecondNumber=number_2)  # -> Equality, Inequality
cull_2 = CullPattern(List=join_2, CullPattern=equals.Inequality)
explode = Explode(Curve=cull_2, Recursive=True)  # -> simplify(graft(Segments)), Vertices
cull_3 = CullPattern(List=crv, CullPattern=equals.Inequality)

# ---- group: GEO (continued)
move_6 = Move(Geometry=cull_3, Motion=rev_2)  # -> Geometry, Transform
explode_2 = Explode(Curve=move_6.Geometry, Recursive=True)  # -> Segments, Vertices

# ----
explode_3 = Explode(Curve=cull_3, Recursive=True)  # -> Segments, Vertices
midpt = CurveMiddle(Curve=explode_3.Segments)

# ---- group: LOGIC
explode_4 = Explode(Curve=explode.Segments, Recursive=True)  # -> simplify(Segments), Vertices
trim_tree = TrimTree(Tree=explode_4.Segments, Depth=1)
midpt_2 = CurveMiddle(Curve=trim_tree)
cp_2 = ClosestPoint(Point=midpt, Cloud=midpt_2)  # -> ClosestPoint, CPIndex, Distance
item_4 = ListItem(List=trim_tree, Index=cp_2.CPIndex, Wrap=True)

# ---- group: GEO (continued)
move_7 = Move(Geometry=item_4, Motion=rev)  # -> Geometry, Transform
explode_5 = Explode(Curve=move_7.Geometry, Recursive=True)  # -> Segments, Vertices
ext = ExtendCurve(Curve=explode_5.Segments, Type=0, Start=division_5, End=division_5)
end = EndPoints(Curve=ext)  # -> Start, End
ln = Line(StartPoint=end.Start, EndPoint=end.End)

# ----
len = Length(Curve=ln)
division_6 = Division(A=len, B=module_size_2)
round_2 = Round(Number=division_6)  # -> Nearest, Floor, Ceiling
divide = DivideCurve(Curve=ln, Count=round_2.Floor, Kinks=False, UseTasks=True)  # -> Points, Tangents, Parameters
shatter = Shatter(Curve=graft(ln), Parameters=divide.Parameters)
explode_6 = Explode(Curve=shatter, Recursive=True)  # -> simplify(Segments), Vertices
len_2 = Length(Curve=explode_6.Segments)
smaller = SmallerThan(FirstNumber=len_2, SecondNumber=wall_width_2)  # -> SmallerThan, OrEqualTo
cull_4 = CullPattern(List=explode_6.Segments, CullPattern=invert(smaller.OrEqualTo))

neg_2 = Negative(Value=wall_width_2)
division_7 = Division(A=neg_2, B=2)
ext_2 = ExtendCurve(Curve=cull_4, Type=0, Start=division_7, End=division_7)
explode_7 = Explode(Curve=ext_2, Recursive=True)  # -> Segments, Vertices

trim_tree_2 = TrimTree(Tree=explode_7.Vertices, Depth=Slider(2, range=0..10))

# ---- group: GEO
crv_2 = Curve(graft(explode_2.Segments))
split = TextSplit(Text=wall_width_2, Separators=".")
crv_cp = CurveClosestPoint(Point=simplify(trim_tree_2), Curve=simplify(crv_2))  # -> Point, Parameter, Distance
item_5 = ListItem(List=split, Index="-1", Wrap=True)
len_3 = TextLength(Text=item_5)
shatter_2 = Shatter(Curve=crv_2, Parameters=simplify(crv_cp.Parameter))
explode_8 = Explode(Curve=shatter_2, Recursive=True)  # -> simplify(Segments), Vertices
len_4 = Length(Curve=explode_8.Segments)
smaller_2 = SmallerThan(FirstNumber=expr("ROUND(X,2)", len_4), SecondNumber=wall_width_2)  # -> SmallerThan, OrEqualTo
cull_5 = CullPattern(List=explode_8.Segments, CullPattern=invert(smaller_2.OrEqualTo))

# ----
trim_tree_3 = TrimTree(Tree=cull_5, Depth=1)
geo_glass = Geometry(trim_tree_3)
geo_glass_2 = Geometry(graft(geo_glass))

# ---- group: DATA
trim_tree_4 = TrimTree(Tree=simplify(geo_glass_2), Depth=1)
lng = ListLength(List=trim_tree_4)
repeat = RepeatData(Data=num_floors_2, Length=lng)
unflatten_tree = UnflattenTree(Tree=repeat, Guide=geo_glass_2)
Z_3 = UnitZ(Factor=unflatten_tree)

trim_tree_5 = TrimTree(Tree=simplify(geo_glass_2), Depth=1)
lng_2 = ListLength(List=trim_tree_5)
repeat_2 = RepeatData(Data=subtraction_3, Length=lng_2)
unflatten_tree_2 = UnflattenTree(Tree=repeat_2, Guide=geo_glass_2)
Z_4 = UnitZ(Factor=unflatten_tree_2)
rev_5 = Reverse(Vector=Z_4)

# ----
geo_glass_3 = Geometry(geo_glass)
move_8 = Move(Geometry=geo_glass_2, Motion=Z_3)  # -> Geometry, Transform
extr = Extrude(Base=move_8.Geometry, Direction=rev_5)
mesh_colours = MeshColours(Mesh=flatten(scale.Geometry), Colours=ColourSwatch(SwatchColor=RGB(125, 125, 125)))
mesh_colours_2 = MeshColours(Mesh=flatten(extr), Colours=ColourSwatch(SwatchColor=RGBA(0, 0, 0, 42)))
area_5 = Area(Geometry=mesh_colours_2)  # -> flatten(Area), Centroid
volume_2 = Volume(Geometry=mesh_colours)  # -> flatten(Volume), Centroid
ma_2 = MassAddition(Input=volume_2.Volume)  # -> Result, PartialResults
ma_3 = MassAddition(Input=area_5.Area)  # -> Result, PartialResults

# ---- group: window
int_3 = Integer(ma_3.Result)

# ----
multiplication = Multiplication(A="0.005", B=int_3)
text_join = TextJoin(Text=["Glass", multiplication], Join=": ")
panel_19 = Panel(text_join)
multiplication_2 = Multiplication(A=multiplication, B="2500")
subtraction_4 = Subtraction(A=int, B=int_3)
multiplication_3 = Multiplication(A=list_item_4, B=subtraction_4)
text_join_2 = TextJoin(Text=[list_item_3, multiplication_3], Join=": ")
multiplication_4 = Multiplication(A=panel_17, B=subtraction_4)
text_join_3 = TextJoin(Text=["Mineral wool", multiplication_4], Join=": ")
panel_20 = Panel(text_join_2)
panel_21 = Panel(text_join_3)
multiplication_5 = Multiplication(A=multiplication_4, B="100")
multiplication_6 = Multiplication(A=multiplication_3, B=list_item_5)

panel_22 = Panel(multiplication_2)
panel_23 = Panel(multiplication_5)
panel_24 = Panel(multiplication_6)
multiplication_7 = Multiplication(A=panel_23, B="1.20")
multiplication_8 = Multiplication(A=panel_24, B=list_item_6)
multiplication_9 = Multiplication(A=panel_22, B="0.85")
panel_25 = Panel(multiplication_9)
panel_26 = Panel(multiplication_7)
panel_27 = Panel(multiplication_8)

merge = Merge(Data1="Volumes m3:", Data2=panel_19, Data3=panel_21, Data4=panel_20, Data5="____________")
integer_2 = Integer(expr("10*round(x/10)", panel_25))
text_join_4 = TextJoin(Text=["Glass", integer_2], Join=": ")
panel_28 = Panel(text_join_4)
integer_3 = Integer(expr("10*round(x/10)", panel_26))
text_join_5 = TextJoin(Text=["Mineral wool", integer_3], Join=": ")
panel_29 = Panel(text_join_5)
integer_4 = Integer(expr("5*round(x/5)", panel_27))
text_join_6 = TextJoin(Text=[list_item_3, integer_4], Join=": ")
panel_30 = Panel(text_join_6)
merge_2 = Merge(Data1="kgCO2:", Data2=panel_28, Data3=panel_29, Data4=panel_30, Data5="____________")
panel_31 = Panel(integer_4)
brep_edges = BrepEdges(Brep=extr)  # -> Naked, Interior, NonManifold
iso_curve = IsoCurve(Surface=reparameterize(extr), UVPoint=panel_6)  # -> UIsocurve, VIsocurve
merge_3 = Merge(Data1=merge, Data2=merge_2)
context_print0 = ContextPrint(Text=merge_3)

# ---- group: GLASS_AREA
int_4 = Integer(ma_3.Result)

# ---- group: SLAB_VOL
int_5 = Integer(ma_2.Result)

# ---- group: GEO
explode_9 = Explode(Curve=geo_glass_3, Recursive=True)  # -> Segments, Vertices
crv_3 = Curve(graft(explode_2.Segments))

# ----
trim_tree_6 = TrimTree(Tree=simplify(explode_9.Vertices), Depth=1)

# ---- group: GEO (continued)
crv_cp_2 = CurveClosestPoint(Point=trim_tree_6, Curve=crv_3)  # -> Point, Parameter, Distance

# ---- group: LOGIC
shatter_3 = Shatter(Curve=crv_3, Parameters=crv_cp_2.Parameter)
len_5 = Length(Curve=shatter_3)
split_2 = TextSplit(Text=number, Separators=".")
item_6 = ListItem(List=split_2, Index="-1", Wrap=True)
len_6 = TextLength(Text=item_6)
smaller_3 = SmallerThan(FirstNumber=expr("ROUND(X,2)", len_5), SecondNumber=number)  # -> SmallerThan, OrEqualTo
cull_6 = CullPattern(List=shatter_3, CullPattern=smaller_3.OrEqualTo)

# ---- group: GEO
geo_glass_4 = Geometry(geo_glass)
num_floors_3 = Number(num_floors)
Z_5 = UnitZ(Factor=num_floors_3)
Z_6 = UnitZ(Factor=slab_thickness)
subtraction_5 = Subtraction(A=num_floors_3, B=slab_thickness)
move_9 = Move(Geometry=simplify(flatten(cull_6)), Motion=Z_5)  # -> Geometry, Transform
move_10 = Move(Geometry=simplify(geo_glass_4), Motion=Z_5)  # -> Geometry, Transform
Z_7 = UnitZ(Factor=subtraction_5)
join_3 = JoinCurves(Curves=move_10.Geometry, Preserve=False)
rev_6 = Reverse(Vector=Z_7)
join_4 = JoinCurves(Curves=move_9.Geometry, Preserve=False)
extr_2 = Extrude(Base=join_3, Direction=Z_6)
extr_3 = Extrude(Base=join_4, Direction=Z_6)
extr_4 = Extrude(Base=join_4, Direction=rev_6)

# ----
deconstruct_brep = DeconstructBrep(Brep=extr_3)  # -> Faces, Edges, Vertices
deconstruct_brep_2 = DeconstructBrep(Brep=extr_4)  # -> Faces, Edges, Vertices
flip = Flip(Surface=deconstruct_brep_2.Faces)  # -> Surface, Result
evaluate_surface = EvaluateSurface(Surface=deconstruct_brep.Faces, Point="0.5,0.5")  # -> Point, Normal, UDirection, VDirection, Frame
evaluate_surface_2 = EvaluateSurface(Surface=flip.Surface, Point="0.5,0.5")  # -> Point, Normal, UDirection, VDirection, Frame
member_index = MemberIndex(Set=evaluate_surface_2.Normal, Member=negative_6)  # -> Index, Count
member_index_2 = MemberIndex(Set=evaluate_surface.Normal, Member=negative_4)  # -> Index, Count
member_index_3 = MemberIndex(Set=evaluate_surface_2.Normal, Member=unit_y_3)  # -> Index, Count
member_index_4 = MemberIndex(Set=evaluate_surface.Normal, Member=unit_y_2)  # -> Index, Count
member_index_5 = MemberIndex(Set=evaluate_surface_2.Normal, Member=negative_7)  # -> Index, Count
list_item_7 = ListItem(List=flip.Surface, Index=member_index.Index, Wrap=True)
member_index_6 = MemberIndex(Set=evaluate_surface.Normal, Member=negative_5)  # -> Index, Count
list_item_8 = ListItem(List=deconstruct_brep.Faces, Index=member_index_2.Index, Wrap=True)
member_index_7 = MemberIndex(Set=evaluate_surface_2.Normal, Member=unit_x_3)  # -> Index, Count
list_item_9 = ListItem(List=flip.Surface, Index=member_index_3.Index, Wrap=True)
member_index_8 = MemberIndex(Set=evaluate_surface.Normal, Member=unit_x_2)  # -> Index, Count
list_item_10 = ListItem(List=deconstruct_brep.Faces, Index=member_index_4.Index, Wrap=True)
list_item_11 = ListItem(List=flip.Surface, Index=member_index_5.Index, Wrap=True)
list_item_12 = ListItem(List=deconstruct_brep.Faces, Index=member_index_6.Index, Wrap=True)
list_item_13 = ListItem(List=flip.Surface, Index=member_index_7.Index, Wrap=True)
entwine_2 = Entwine(Branch00=list_item_13, Branch01=list_item_11, Branch02=list_item_9, Branch03=list_item_7, FlattenInputs=True)
list_item_14 = ListItem(List=deconstruct_brep.Faces, Index=member_index_8.Index, Wrap=True)
entwine_3 = Entwine(Branch00=list_item_14, Branch01=list_item_12, Branch02=list_item_10, Branch03=list_item_8, FlattenInputs=True)
trim_tree_7 = TrimTree(Tree=simplify(extr_2), Depth=1)
deconstruct_brep_3 = DeconstructBrep(Brep=trim_tree_7)  # -> Faces, Edges, Vertices
evaluate_surface_3 = EvaluateSurface(Surface=deconstruct_brep_3.Faces, Point="0.5,0.5")  # -> Point, Normal, UDirection, VDirection, Frame
member_index_9 = MemberIndex(Set=evaluate_surface_3.Normal, Member=negative_2)  # -> Index, Count
member_index_10 = MemberIndex(Set=evaluate_surface_3.Normal, Member=unit_y)  # -> Index, Count
member_index_11 = MemberIndex(Set=evaluate_surface_3.Normal, Member=negative_3)  # -> Index, Count
list_item_15 = ListItem(List=deconstruct_brep_3.Faces, Index=member_index_9.Index, Wrap=True)
member_index_12 = MemberIndex(Set=evaluate_surface_3.Normal, Member=unit_x)  # -> Index, Count
list_item_16 = ListItem(List=deconstruct_brep_3.Faces, Index=member_index_10.Index, Wrap=True)
list_item_17 = ListItem(List=deconstruct_brep_3.Faces, Index=member_index_11.Index, Wrap=True)
list_item_18 = ListItem(List=deconstruct_brep_3.Faces, Index=member_index_12.Index, Wrap=True)
entwine_4 = Entwine(Branch00=list_item_18, Branch01=list_item_17, Branch02=list_item_16, Branch03=list_item_15, FlattenInputs=True)
merge_4 = Merge(Data1=entwine_4, Data2=entwine_3, Data3=entwine_2)

# ---- group: GEO
# FACADE
# Plain
merge_5 = Merge(Data1=unit_x_4, Data2=negative_8, Data3=unit_y_4, Data4=negative_9)
negative_10 = Negative(Value=merge_5)
extrude_3 = Extrude(Base=merge_4, Direction=graft(negative_10))

# ----
mesh_colours_3 = MeshColours(Mesh=flatten(extrude_3), Colours=stream_filter)
volume_3 = Volume(Geometry=mesh_colours_3)  # -> flatten(Volume), Centroid
ma_4 = MassAddition(Input=volume_3.Volume)  # -> Result, PartialResults
mesh_join = MeshJoin(Meshes=flatten([mesh_colours, mesh_colours_3]))
bounding_box = BoundingBox(Content=mesh_join, Plane=PlaneXY(0, 0, 0), UnionBox=True)  # -> Box, Box_2
deconstruct_brep_4 = DeconstructBrep(Brep=bounding_box.Box)  # -> Faces, Edges, Vertices
list_item_19 = ListItem(List=deconstruct_brep_4.Edges, Index=0, Wrap=True)  # -> Item1, Item
unit_z_4 = UnitZ(Factor=expr("x/2", list_item_19.Item1))
move_11 = Move(Geometry=mesh_join, Motion=unit_z_4)  # -> Geometry, Transform
move_12 = Move(Geometry=[iso_curve.UIsocurve, iso_curve.VIsocurve, brep_edges.Naked], Motion=unit_z_4)  # -> Geometry, Transform
mesh = Mesh([move_11.Geometry, list_item_2])
context_bake = ContextBake(Geometry=move_12.Geometry)
context_bake_2 = ContextBake(Geometry=mesh)

# ---- group: FAC_VOL
int_6 = Integer(ma_4.Result)
