# Grasshopper definition LatStudio.gh (Grasshopper 1.0.7)
# plug-ins: Volvox, treesloth01, Mesh Pipe, Pufferfish, EleFront

file_path = FilePath(["D:\Users\alber\Desktop\THESIS\01 Modelling\04 Imports\230912_rotating\InterpolateALL\xyz\type_1.xyz", "D:\Users\alber\Desktop\THESIS\01 Modelling\04 Imports\230912_rotating\InterpolateALL\xyz\type_2.xyz", "D:\Users\alber\Desktop\THESIS\01 Modelling\04 Imports\230912_rotating\InterpolateALL\xyz\type_3.xyz", "D:\Users\alber\Desktop\THESIS\01 Modelling\04 Imports\230912_rotating\InterpolateALL\xyz\type_4.xyz", "D:\Users\alber\Desktop\THESIS\01 Modelling\04 Imports\230912_rotating\InterpolateALL\xyz\type_5.xyz", "D:\Users\alber\Desktop\THESIS\01 Modelling\04 Imports\230912_rotating\InterpolateALL\xyz\type_6.xyz"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])
number_slider = Slider(2, range=0..9)  # disabled
corner_window = BooleanToggle(False)  # disabled
load_xyz = LoadXyz(FilePath=file_path, Mask="z y x", Percent=1)  # disabled
facade_material_2 = GetInteger(number_slider, AtLeast=0, AtMost=4, Maximum=2147483647, Minimum=-2147483648, TreeAccess=False)  # disabled
facade_material = GetInteger(Slider(0, range=0..9), AtLeast=0, AtMost=4, Maximum=2147483647, Minimum=-2147483648, TreeAccess=False)
length = GetInteger(Slider(0, range=0..36), AtLeast=1, AtMost=1, Maximum=2147483647, Minimum=-2147483648, TreeAccess=False)
corner = GetBoolean(corner_window, AtLeast=0, AtMost=1, FalseValue="False", TreeAccess=False, TrueValue="True")  # disabled
cloud = Cloud([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])

# ---- group: glitching
panel = Panel("""256
257
258""")
panel_2 = Panel("""236
237
238""")
panel_3 = Panel("""204
205
206""")
panel_4 = Panel("""178
179
180""")
panel_5 = Panel("""147
148
149""")
panel_6 = Panel("""136
137
138""")
panel_7 = Panel("""118
119
120""")
panel_8 = Panel("""89
90
91""")
panel_9 = Panel("""59
60
61""")
panel_10 = Panel("""23
24
25""")
panel_11 = Panel("""0
1
2""")
stack_trees = StackTrees(
    Data0=panel_11,
    Data1=panel_10,
    Data2=panel_9,
    Data3=panel_8,
    Data4=panel_7,
    Data5=panel_6,
    Data6=panel_5,
    Data7=panel_4,
    Data8=panel_3,
    Data9=panel_2,
    Reduce=True)

# ----
addition = Addition(A=facade_material, B=1)
list_item = ListItem(List=stack_trees, Index=0, Wrap=True)
num_ids = Number(simplify(list_item))
tree_branch = TreeBranch(Tree=num_ids, Path=facade_material, MaintainPaths=True)
tree_branch_2 = TreeBranch(Tree=num_ids, Path=addition, MaintainPaths=True)
list_item_2 = ListItem(List=cloud, Index=tree_branch, Wrap=True)
list_item_3 = ListItem(List=cloud, Index=tree_branch_2, Wrap=True)
construct_domain = ConstructDomain(DomainStart=tree_branch, DomainEnd=tree_branch_2)

panel_12 = Panel("Color Table - Bordeaux")
r255_g246_b141 = ColourSwatch(SwatchColor=RGB(255, 246, 141))
r255_g239_b000 = ColourSwatch(SwatchColor=RGB(255, 239, 0))
r255_g206_b052 = ColourSwatch(SwatchColor=RGB(255, 206, 52))
r242_g103_b036 = ColourSwatch(SwatchColor=RGB(242, 103, 36))
r244_g120_b080 = ColourSwatch(SwatchColor=RGB(244, 120, 80))
r238_g046_b036 = ColourSwatch(SwatchColor=RGB(238, 46, 36))
r169_g017_b044 = ColourSwatch(SwatchColor=RGB(169, 17, 44))
r245_g152_b160 = ColourSwatch(SwatchColor=RGB(245, 152, 160))
r251_g213_b217 = ColourSwatch(SwatchColor=RGB(251, 213, 217))
r238_g055_b128 = ColourSwatch(SwatchColor=RGB(238, 55, 128))
r145_g097_b168 = ColourSwatch(SwatchColor=RGB(145, 97, 168))
r253_g234_b236 = ColourSwatch(SwatchColor=RGB(253, 234, 236))
r245_g159_b185 = ColourSwatch(SwatchColor=RGB(245, 159, 185))
r219_g070_b153 = ColourSwatch(SwatchColor=RGB(219, 70, 153))
r244_g208_b230 = ColourSwatch(SwatchColor=RGB(224, 208, 230))
r113_g113_b180 = ColourSwatch(SwatchColor=RGB(113, 113, 180))
r000_g170_b231 = ColourSwatch(SwatchColor=RGB(0, 170, 231))
r190_g175_b214 = ColourSwatch(SwatchColor=RGB(190, 175, 214))
r036_g060_b150 = ColourSwatch(SwatchColor=RGB(36, 60, 150))
r191_g231_b247 = ColourSwatch(SwatchColor=RGB(191, 231, 247))
r162_g218_b222 = ColourSwatch(SwatchColor=RGB(162, 218, 222))
r000_g181_b180 = ColourSwatch(SwatchColor=RGB(0, 181, 180))
r000_g102_b125 = ColourSwatch(SwatchColor=RGB(0, 102, 125))
r011_g177_b078 = ColourSwatch(SwatchColor=RGB(11, 177, 78))
r157_g210_b159 = ColourSwatch(SwatchColor=RGB(157, 210, 159))
r185_g217_b134 = ColourSwatch(SwatchColor=RGB(185, 217, 134))
r145_g200_b072 = ColourSwatch(SwatchColor=RGB(145, 200, 72))
r181_g211_b052 = ColourSwatch(SwatchColor=RGB(181, 211, 52))
r144_g141_b018 = ColourSwatch(SwatchColor=RGB(144, 141, 18))
r199_g201_b201 = ColourSwatch(SwatchColor=RGB(199, 201, 201))
r231_g221_b182 = ColourSwatch(SwatchColor=RGB(231, 221, 182))
r214_g191_b145 = ColourSwatch(SwatchColor=RGB(214, 191, 145))

stack_trees_2 = StackTrees(Data0=list_item_2, Data1=list_item_3, Reduce=True)
voxel_colored = VoxelColored(Cloud=stack_trees_2, VoxelSize=Slider(1.01, range=0..2))
sub_list = SubList(List=cloud, Domain=construct_domain, Wrap=True)  # -> List, Index
list_length = ListLength(List=sub_list.List)  # -> expr("x-1", Length)
range = Range(Domain=list_length, Steps=Slider(11, range=0..100))
unweld_mesh = UnweldMesh(Mesh=voxel_colored, Angle=1.570796327)
inte_lenght = Integer(length)

deconstruct_mesh = DeconstructMesh(Mesh=unweld_mesh)  # -> Vertices, Faces, Colours, Normals
construct_mesh = ConstructMesh(Vertices=deconstruct_mesh.Vertices, Faces=deconstruct_mesh.Faces, Colours=deconstruct_mesh.Normals)

deconstruct_cloud = DeconstructCloud(Cloud=sub_list.List)  # -> simplify(Points), Normals, Colors; disabled
list_item_4 = ListItem(List=sub_list.List, Index=range, Wrap=invert(True))
tree_branch_3 = TreeBranch(Tree=deconstruct_cloud.Points, Path=inte_lenght, MaintainPaths=True)
boolean = Boolean(False)
unit_x = UnitX(Factor=Slider(40, range=0..245))
negative = Negative(Value=unit_x)
multiplication = Multiplication(A=unit_x, B=2)
move = Move(Geometry=list_item_4, Motion=negative)  # -> Geometry, Transform
list_length_2 = ListLength(List=move.Geometry)  # -> expr("x-1", Length)
range_2 = Range(Domain=multiplication, Steps=list_length_2)
bool_voxel = Boolean(False)
unit_x_2 = UnitX(Factor=range_2)
move_2 = Move(Geometry=move.Geometry, Motion=unit_x_2)  # -> Geometry, Transform
stream_gate = StreamGate(Stream=list_item_4, Gate=bool_voxel)  # -> Target0, Target1
voxel_colored_2 = VoxelColored(Cloud=stream_gate.Target0, VoxelSize=Slider(0.51, range=0..2))  # disabled
stream_filter = StreamFilter(Gate=bool_voxel, Stream0=tree_branch_3, Stream1=voxel_colored_2)
unit_x_3 = UnitX(Factor=Slider(80, range=0..245))
deconstruct_cloud_2 = DeconstructCloud(Cloud=move_2.Geometry)  # -> Points, Normals, Colors
negative_2 = Negative(Value=unit_x_3)
voxel = Voxel(Points=deconstruct_cloud_2.Points, X=1, Y=1, Z=1)
unweld_mesh_2 = UnweldMesh(Mesh=voxel, Angle=1.570796327)
move_3 = Move(Geometry=construct_mesh, Motion=graft([negative_2, unit_x_3]))  # -> flatten(Geometry), Transform
context_bake = ContextBake(Geometry=stream_filter)  # disabled
mesh_join = MeshJoin(Meshes=move_3.Geometry)
list_item_5 = ListItem(List=flatten(unweld_mesh_2), Index=Slider(10, range=0..23), Wrap=invert(True))
context_bake_2 = ContextBake(Geometry=flatten([mesh_join, stream_filter, voxel_colored_2]))
rebuild_mesh = RebuildMesh(
    Mesh=unweld_mesh_2,
    RebuildNormals=invert(False),
    CullUnused=False,
    UnifyNormals=False,
    FlipNormals=False,
    IdenticalCombine=False,
    WeldVertices=0)  # -> flatten(Rebuilt)
list_length_3 = ListLength(List=rebuild_mesh)
series = Series(Start=0, Step=1, Count=list_length_3)
define_object_attributes = DefineObjectAttributes(Name=series)
custom_preview = CustomPreview(Geometry=rebuild_mesh, Material=ColourSwatch(SwatchColor=RGB(235, 235, 235)))
bake_objects = BakeObjects(Geometry=flatten(rebuild_mesh), Attributes=define_object_attributes, Bake=False)
