# Grasshopper definition janasemaan_encoded_art.gh (Grasshopper 1.0.7)

number_slider = Slider(5, range=0..10000)
square_side_size = GetInteger(Slider(50, range=0..100), AtLeast=1, AtMost=1, Maximum=2147483647, Minimum=-2147483648, TreeAccess=False)
input_text = GetString("hello world!", AtLeast=1, AtMost=1, TreeAccess=False)
depth_change_intensity = GetNumber(Slider(1.11, range=-1..2), AtLeast=1, AtMost=1, Maximum=1.797693135e+308, Minimum=-1.797693135e+308, TreeAccess=False)
material_selector = GetInteger(Slider(0, range=0..2), AtLeast=1, AtMost=1, Maximum=2147483647, Minimum=-2147483648, TreeAccess=False)

# ---- group: ENCRYPT STRING
ghpython_script = GhPythonScript(w=input_text)  # -> vow, avg, len, dup
# ---------- ghpython_script: Python ----------
len=0
vow=0
dup=0
vowels='aeiouAEIOU'
dupcheck=''
tot_ord=0

for i in w:
    len+=1
    tot_ord=tot_ord+ ord(i)
    if i in dupcheck:
        dup+=1
    dupcheck=dupcheck+i
    if i in vowels:
        vow+=1

avg=tot_ord/len
# ---------- end ghpython_script ----------

# ----
square_root = SquareRoot(Value=ghpython_script.len)
plane_surface = PlaneSurface(Plane=PlaneXY(0, 0, 0), XSize=square_side_size, YSize=square_side_size)
round = Round(Number=square_root)  # -> Nearest, Floor, Ceiling
integer = Integer(ghpython_script.vow)
divide_domain² = DivideDomain²(Domain=plane_surface, UCount=round.Ceiling, VCount=round.Ceiling)
isotrim = Isotrim(Surface=plane_surface, Domain=divide_domain²)
dimensions = Dimensions(Surface=isotrim)  # -> UDimension, VDimension
list_item = ListItem(List=dimensions.UDimension, Index=0, Wrap=True)
integer_2 = Integer(ghpython_script.avg)
addition = Addition(A=ghpython_script.dup, B=1)

# ---- group: GET THICKNESSES
number_slider_2 = Slider(0.7, range=0..1)
multiplication = Multiplication(A=Slider(0.2, range=0..1), B=list_item)
multiplication_2 = Multiplication(A=list_item, B=depth_change_intensity)
construct_domain = ConstructDomain(DomainStart=multiplication, DomainEnd=multiplication_2)
range = Range(Domain=construct_domain, Steps=addition)
list_item_2 = ListItem(List=range, Index=0, Wrap=True)

# ----
cull_index = CullIndex(List=range, Indices=Slider(0, range=0..100), Wrap=True)
jitter = Jitter(List=isotrim, Jitter=1, Seed=integer_2)  # -> Values, Indices
split_list = SplitList(List=jitter.Values, Index=ghpython_script.len)  # -> ListA, ListB
unit_z = UnitZ(Factor=list_item_2)
extrude = Extrude(Base=split_list.ListB, Direction=unit_z)
unit_z_2 = UnitZ(Factor=cull_index)
extrude_2 = Extrude(Base=split_list.ListA, Direction=unit_z_2)
jitter_2 = Jitter(List=extrude_2, Jitter=1, Seed=2)  # -> Values, Indices
split_list_2 = SplitList(List=jitter_2.Values, Index=integer)  # -> ListA, ListB
volume = Volume(Geometry=split_list_2.ListA)  # -> Volume, Centroid
scale = Scale(Geometry=split_list_2.ListA, Center=volume.Centroid, Factor=Slider(0.75, range=0..1))  # -> Geometry, Transform
geometry = Geometry(split_list_2.ListB)
scale_nu = ScaleNU(Geometry=scale.Geometry, Plane=volume.Centroid, ScaleX=1, ScaleY=1, ScaleZ=Slider(5, range=0..10))  # -> Geometry, Transform
solid_difference = SolidDifference(BrepsA=split_list_2.ListA, BrepsB=scale_nu.Geometry)
merge = Merge(Data1=flatten(solid_difference), Data2=flatten(geometry), Data3=flatten(extrude))  # -> simplify(Result)
bbox = BoundingBox(Content=merge, Plane=PlaneXY(0, 0, 0), UnionBox=True)  # -> Box, Box_2
area = Area(Geometry=bbox.Box)  # -> Area, Centroid
pt = Point(Point(0, 0, 0))
vec2pt = Vector2Pt(PointA=area.Centroid, PointB=pt, Unitize=False)  # -> Vector, Length
move = Move(Geometry=merge, Motion=vec2pt.Vector)  # -> Geometry, Transform
mesh = MeshBrep(
    Brep=move.Geometry,
    Settings={GridMaxCount=0, GridMinCount=16, JaggedSeams=False, MaxEdgeLength=0, MinEdgeLength=0.0001, MinTolerance=0, Refine=True, RefineAngle=0, RelativeTolerance=0.65, SimplePlanes=True, Tolerance=0})
wires = BrepWireframe(Brep=move.Geometry, Density=-1)
mesh_2 = Mesh(mesh)
number_slider_3 = Slider(0.2, range=0..1)
number_slider_4 = Slider(2, range=0..10)

# ---- group: 3DP PLA
subtraction = Subtraction(A=number_slider_3, B=Slider(0.1, range=0..0.1))
contour = Contour(Shape=mesh_2, Point=Point(0, 0, 0), Direction=Vector(0, 0, 1), Distance=number_slider_3)
Z = UnitZ(Factor=subtraction)
extr = Extrude(Base=contour, Direction=Z)
mesh_3 = MeshBrep(
    Brep=extr,
    Settings={GridMaxCount=0, GridMinCount=16, JaggedSeams=False, MaxEdgeLength=0, MinEdgeLength=0.0001, MinTolerance=0, Refine=True, RefineAngle=0, RelativeTolerance=0.65, SimplePlanes=True, Tolerance=0})

# ---- group: 3DP CLAY
subtraction_2 = Subtraction(A=number_slider_4, B=Slider(0.1, range=0..0.1))
contour_2 = Contour(Shape=mesh_2, Point=Point(0, 0, 0), Direction=Vector(0, 0, 1), Distance=number_slider_4)
Z_2 = UnitZ(Factor=subtraction_2)
extr_2 = Extrude(Base=contour_2, Direction=Z_2)
mesh_4 = MeshBrep(
    Brep=extr_2,
    Settings={GridMaxCount=0, GridMinCount=16, JaggedSeams=False, MaxEdgeLength=0, MinEdgeLength=0.0001, MinTolerance=0, Refine=True, RefineAngle=0, RelativeTolerance=0.65, SimplePlanes=True, Tolerance=0})

# ----
unweld = UnweldMesh(Mesh=mesh_2, Angle=1.570796327)
wheel = ColourWheel(
    Slider(8, range=0..10),
    ColourGrips_Style=10,
    ColourGrips_Grip=[4.697671516, 2.709706658, 4.804101761, 3.583734693],
    ColourGrips_Lum=[0.8343047347, 1],
    ColourGrips_Range=[0.06898579674, 0.06898579674, 0.06898579674, 0.06898579674],
    ColourGrips_Sat=[0.07468375433, 0])
wheel_2 = ColourWheel(
    Slider(8, range=0..10),
    ColourGrips_Style=10,
    ColourGrips_Grip=[3.754222946, 2.709706658, 4.804101761, 3.583734693],
    ColourGrips_Lum=[0.8343047347, 1],
    ColourGrips_Range=[0.2617993878, 0.2617993878, 0.2617993878, 0.2617993878],
    ColourGrips_Sat=[0.9805724581, 0.7621701198])
wheel_3 = ColourWheel(
    Slider(25, range=0..100),
    ColourGrips_Style=10,
    ColourGrips_Grip=[4.409145763, 2.709706658, 4.804101761, 3.583734693],
    ColourGrips_Lum=[0.8645833146, 1],
    ColourGrips_Range=[0.3669759121, 0.3669759121, 0.3669759121, 0.3669759121],
    ColourGrips_Sat=[0.1109971704, 0])
unim = UnifyMesh(Mesh=mesh_3)  # -> Result, Count
unim_2 = UnifyMesh(Mesh=mesh_4)  # -> Result, Count
mcol = MeshColours(Mesh=unweld, Colours=wheel)
mcol_2 = MeshColours(Mesh=unim.Result, Colours=wheel_2)
mcol_3 = MeshColours(Mesh=unim_2.Result, Colours=wheel_3)
entwine = Entwine(Branch00=wires, Branch01=contour, Branch02=contour_2, FlattenInputs=True)  # -> simplify(Result)
entwine_2 = Entwine(Branch00=mcol, Branch01=mcol_2, Branch02=mcol_3, FlattenInputs=True)  # -> simplify(Result)
volume_2 = Volume(Geometry=unweld)  # -> Volume, Centroid

# ---- group: dollar per m3
multiplication_3 = Multiplication(A="2596", B=".2")

multiplication_4 = Multiplication(A="1240", B="20")

# ----
mass_addition = MassAddition(Input=flatten(volume_2.Volume))  # -> Result, PartialResults

# ---- group: cubic m
division = Division(A=mass_addition.Result, B="1e+9")

division_2 = Division(A=mass_addition.Result, B="1e+9")

# ----
multiplication_5 = Multiplication(A=multiplication_3, B=division)
multiplication_6 = Multiplication(A=multiplication_4, B=division_2)
branch = TreeBranch(Tree=entwine_2, Path=material_selector, MaintainPaths=True)
branch_2 = TreeBranch(Tree=entwine, Path=material_selector, MaintainPaths=True)
concat = Concatenate(FragmentA=multiplication_6, FragmentB="$  *Assuming 20$ per kg and 1240 kg/m3")
concat_2 = Concatenate(FragmentA=multiplication_5, FragmentB="$  *Assuming 0.2$ per kg and 2596 kg/m3")
concat_3 = Concatenate(FragmentA=mass_addition.Result, FragmentB="MM3")
merge_2 = Merge(Data1="0", Data2=concat, Data3=concat_2)
item = ListItem(List=merge_2, Index=material_selector, Wrap=True)
context_print = ContextPrint(MATERIALVOLUME=concat_3)
context_print_2 = ContextPrint(MATERIALCOST=item)
context_bake = ContextBake(ARTWORKlines=branch_2)
context_bake_2 = ContextBake(Geometry=branch)
